# Grasshopper definition KinergyMainInterface.gh (Grasshopper 1.0.7)
# plug-ins: Human UI

# ---- group: Top Menu
number_slider = Slider(0, range=0..100)
width = Slider(186, range=0..1000)
height = Slider(35, range=0..1000)
width_2 = Slider(85, range=0..1000)
height_2 = Slider(35, range=0..1000)
width_3 = Slider(95, range=0..1000)
height_3 = Slider(35, range=0..1000)
width_4 = Slider(90, range=0..1000)
height_4 = Slider(35, range=0..1000)
radiobtn = CreateRadioButton(RadioButtonName="Intermittent", RadioButtonGroup="motion type", InitiallySelected=False)
adjustpos = AdjustElementPositioning(
    ElementsToAdjust=radiobtn,
    Margin="290,-45,0,10",
    AbsolutePositioning=False,
    Width=width_4,
    Height=height_4,
    HorizontalAlignment=Slider(0, range=0..100))
radiobtn_2 = CreateRadioButton(RadioButtonName="Reciprocated", RadioButtonGroup="motion type", InitiallySelected=False)
adjustpos_2 = AdjustElementPositioning(
    ElementsToAdjust=radiobtn_2,
    Margin="180,-45,0,10",
    AbsolutePositioning=False,
    Width=width_3,
    Height=height_3,
    HorizontalAlignment=Slider(0, range=0..100))
radiobtn_3 = CreateRadioButton(RadioButtonName="Instant", RadioButtonGroup="motion type", InitiallySelected=False)
adjustpos_3 = AdjustElementPositioning(
    ElementsToAdjust=radiobtn_3,
    Margin="5,-10,0,10",
    AbsolutePositioning=False,
    Width=width,
    Height=height,
    HorizontalAlignment=number_slider)
radiobtn_4 = CreateRadioButton(RadioButtonName="Continuous", RadioButtonGroup="motion type", InitiallySelected=False)
adjustpos_4 = AdjustElementPositioning(
    ElementsToAdjust=radiobtn_4,
    Margin="80,-45,0,10",
    AbsolutePositioning=False,
    Width=width_2,
    Height=height_2,
    HorizontalAlignment=Slider(0, range=0..100))
label = CreateLabel(LabelText="Select a target motion type:", LabelSize=12, Justification=0)
adjustpos_5 = AdjustElementPositioning(
    ElementsToAdjust=label,
    Margin="0,0,0,5",
    AbsolutePositioning=False,
    Width=width,
    Height=height,
    HorizontalAlignment=number_slider)

# ----
angle = Slider(10.187, range=0..20)
width_5 = Slider(385, range=0..400)
height_5 = Slider(30, range=0..30)
slider = CreateSlider(Slider=angle, ShowBounds=False, ShowTicks=False, ShowTooltip=False, ShowValLabel=True, showLabel=True)
adjustpos_6 = AdjustElementPositioning(
    ElementsToAdjust=slider,
    Margin="10,10,0,5",
    AbsolutePositioning=False,
    Width=width_5,
    Height=height_5,
    HorizontalAlignment=Slider(0, range=0..100))

# ---- group: Reset Motion
width_6 = Slider(50, range=0..1000)
height_6 = Slider(30, range=0..1000)
button = CreateButton(ButtonName="Clear", ButtonStyle=0)
adjustpos_7 = AdjustElementPositioning(
    ElementsToAdjust=button,
    Margin="270,-45,0,10",
    AbsolutePositioning=False,
    Width=width_6,
    Height=height_6,
    HorizontalAlignment=Slider(0, range=0..100))
values = ValueListener(Elements=button, SomeProperty=True)  # -> Values, Indices

# ---- group: Motion Selection Logic
values_2 = ValueListener(Elements=radiobtn_3, SomeProperty=True)  # -> Values, Indices
values_3 = ValueListener(Elements=radiobtn_4, SomeProperty=True)  # -> Values, Indices
values_4 = ValueListener(Elements=radiobtn_2, SomeProperty=True)  # -> Values, Indices
values_5 = ValueListener(Elements=radiobtn, SomeProperty=True)  # -> Values, Indices
rotating = Panel(values_3.Values)
translating = Panel(values_2.Values)
oscillating = Panel(values_4.Values)
translating_oscillating = Panel(values_5.Values)
python = GhPythonScript(x=values_2.Values, y=values_3.Values, z=values_4.Values, u=values_5.Values)  # -> a, b, c, d, e
# ---------- python: Python ----------
#provides a scripting component.
#    Inputs:
#        x: Translation button listener
#        y: Rotation button listener
#        z: Oscillating button listener
#        u: Translation+oscillating button listener
#    Output:
#        a: Visibility indicator for the translation control panel
#        b: Visibility indicator for the rotation control panel
#        c: Visibility indicator for the oscillating control panel
#        d: Visibility indicator for the translation + oscillating control panel
#        e: Visibility indicator for the default control panel
#
#__author__ = "ediga"
#__version__ = "2020.07.28"

import rhinoscriptsyntax as rs


if x and not y and not z and not u:
    a = True
    b = False
    c = False
    d = False
    e = False
elif not x and y and not z and not u:
    a = False
    b = True
    c = False
    d = False
    e = False
elif not x and not y and z and not u:
    a = False
    b = False
    c = True
    d = False
    e = False
elif not x and not y and not z and u:
    a = False
    b = False
    c = False
    d = True
    e = False
else:
    a = False
    b = False
    c = False
    d = False
    e = True
# ---------- end python ----------

# ---- group: Continuous Motion
separatorheight = Slider(4, range=0..10)
colour = ColourPicker(PickedColour=RGB(230, 230, 230))
colour_2 = ColourPicker(PickedColour=RGB(101, 168, 99))
separatorheight_2 = Slider(10, range=0..10)
strength = Slider(0.5, range=0..1)
colour_3 = ColourPicker(PickedColour=RGB(230, 230, 230))
width_7 = Slider(400, range=0..1000)
width_8 = Slider(110, range=0..1000)
height_7 = Slider(35, range=0..1000)
width_9 = Slider(380, range=0..400)
height_8 = Slider(30, range=0..30)
width_10 = Slider(566, range=0..1000)
height_9 = Slider(38, range=0..1000)
titlesize = Slider(20, range=0..30)
width_11 = Slider(100, range=0..1000)
height_10 = Slider(30, range=0..1000)
separator = CreateSeparator(Thickness=0.5, Horizontal=True, Color=colour, Height=separatorheight)
slider_2 = CreateSlider(Slider=strength, ShowBounds=False, ShowTicks=False, ShowTooltip=False, ShowValLabel=True, showLabel=True)
separator_2 = CreateSeparator(Thickness=0.5, Horizontal=True, Color=colour_3, Width=width_7, Height=separatorheight_2)
label_2 = CreateLabel(LabelText="Output trajectory:", LabelSize=12, Justification=0)
width_12 = Slider(130, range=0..1000)
height_11 = Slider(35, range=0..1000)
label_3 = CreateLabel(LabelText="Kinetic Unit for Continuous Motion", LabelSize=12, Justification=0)
label_4 = CreateLabel(LabelText="Load motion action:", LabelSize=12, Justification=0)
adjustpos_8 = AdjustElementPositioning(
    ElementsToAdjust=slider_2,
    Margin="10,5,0,10",
    AbsolutePositioning=False,
    Width=width_9,
    Height=height_8,
    HorizontalAlignment=Slider(0, range=0..100))
adjustpos_9 = AdjustElementPositioning(
    ElementsToAdjust=label_2,
    Margin="10,-10,0,10",
    AbsolutePositioning=False,
    Width=width_8,
    Height=height_7,
    HorizontalAlignment=Slider(0, range=0..100))
adjustpos_10 = AdjustElementPositioning(
    ElementsToAdjust=label_3,
    Margin="10,5,0,10",
    AbsolutePositioning=False,
    Width=width_10,
    Height=height_9,
    HorizontalAlignment=Slider(0, range=0..100))
true_button = CreateTrueOnlyButton(ButtonName="Select a region ", ButtonStyle=0)
adjustelem = AdjustElementAppearance(ElementsToAdjust=label_3, Foreground=colour_2, FontSize=titlesize)
distance = Slider(10, range=0..20)
adjustpos_11 = AdjustElementPositioning(
    ElementsToAdjust=true_button,
    Margin="10,0,0,10",
    AbsolutePositioning=False,
    Width=width_11,
    Height=height_10,
    HorizontalAlignment=Slider(0, range=0..100))
width_13 = Slider(450, range=0..1000)
height_12 = Slider(35, range=0..1000)
separatorheight_3 = Slider(4, range=0..10)
width_14 = Slider(100, range=0..1000)
height_13 = Slider(30, range=0..1000)
adjustpos_12 = AdjustElementPositioning(
    ElementsToAdjust=label_4,
    Margin="10,5,0,10",
    AbsolutePositioning=False,
    Width=width_12,
    Height=height_11,
    HorizontalAlignment=Slider(0, range=0..100))
checkbox = CreateCheckbox(Label="Add a lock", StartingValue=False)
colour_4 = ColourPicker(PickedColour=RGB(230, 230, 230))
width_15 = Slider(110, range=0..1000)
height_14 = Slider(35, range=0..1000)
height_15 = Slider(30, range=0..30)
width_16 = Slider(400, range=0..1000)
width_17 = Slider(380, range=0..400)
height_16 = Slider(38, range=0..1000)
label_5 = CreateLabel(LabelText="Continuous Motion", LabelSize=12, Justification=0)
width_18 = Slider(566, range=0..1000)
adjustpos_13 = AdjustElementPositioning(ElementsToAdjust=checkbox, Margin="15,5,0,10", AbsolutePositioning=False, Width=width_13, Height=height_12)
width_19 = Slider(110, range=0..1000)
height_17 = Slider(35, range=0..1000)
slider_3 = CreateSlider(Slider=distance, ShowBounds=False, ShowTicks=False, ShowTooltip=False, ShowValLabel=True, showLabel=True)
radiobtn_5 = CreateRadioButton(RadioButtonName="Turn", RadioButtonGroup="continuous_motion_input_action", InitiallySelected=False)
radiobtn_6 = CreateRadioButton(RadioButtonName="Line", RadioButtonGroup="continuous_motion_output_behavior", InitiallySelected=False)
adjustpos_14 = AdjustElementPositioning(
    ElementsToAdjust=slider_3,
    Margin="10,0,0,10",
    AbsolutePositioning=False,
    Width=width_17,
    Height=height_15,
    HorizontalAlignment=Slider(0, range=0..100))
separator_3 = CreateSeparator(Thickness=0.5, Horizontal=True, Color=colour_4, Width=width_16, Height=separatorheight_3)
adjustpos_15 = AdjustElementPositioning(
    ElementsToAdjust=label_5,
    Margin="10,5,0,10",
    AbsolutePositioning=False,
    Width=width_18,
    Height=height_16,
    HorizontalAlignment=Slider(0, range=0..100))
height_18 = Slider(30, range=0..1000)
width_20 = Slider(50, range=0..1000)
width_21 = Slider(90, range=0..1000)
adjustpos_16 = AdjustElementPositioning(
    ElementsToAdjust=radiobtn_6,
    Margin="125,-55,0,10",
    AbsolutePositioning=False,
    Width=width_15,
    Height=height_14,
    HorizontalAlignment=Slider(0, range=0..100))
height_19 = Slider(30, range=0..1000)
adjustpos_17 = AdjustElementPositioning(
    ElementsToAdjust=radiobtn_5,
    Margin="135,-55,0,10",
    AbsolutePositioning=False,
    Width=width_19,
    Height=height_17,
    HorizontalAlignment=Slider(0, range=0..100))
width_22 = Slider(200, range=0..1000)
height_20 = Slider(30, range=0..1000)
titlesize_2 = Slider(20, range=0..30)
colour_5 = ColourPicker(PickedColour=RGB(51, 121, 200))
button_2 = CreateButton(ButtonName="Preview", ButtonStyle=0)
true_button_2 = CreateTrueOnlyButton(ButtonName="End-effector", ButtonStyle=0)
rounds = Slider(10, range=0..20)
true_button_3 = CreateTrueOnlyButton(ButtonName="Input", ButtonStyle=0)
width_23 = Slider(115, range=0..1000)
height_21 = Slider(35, range=0..1000)
adjustpos_18 = AdjustElementPositioning(
    ElementsToAdjust=button_2,
    Margin="180,-45,0,10",
    AbsolutePositioning=False,
    Width=width_22,
    Height=height_20,
    HorizontalAlignment=Slider(0, range=0..100))
adjustpos_19 = AdjustElementPositioning(
    ElementsToAdjust=true_button_2,
    Margin="290,-40,0,15",
    AbsolutePositioning=False,
    Width=width_21,
    Height=height_19,
    HorizontalAlignment=Slider(0, range=0..100))
adjustpos_20 = AdjustElementPositioning(
    ElementsToAdjust=true_button_3,
    Margin="230,-40,0,10",
    AbsolutePositioning=False,
    Width=width_20,
    Height=height_18,
    HorizontalAlignment=Slider(0, range=0..100))
adjustelem_2 = AdjustElementAppearance(ElementsToAdjust=label_5, Foreground=colour_5, FontSize=titlesize_2)
radiobtn_7 = CreateRadioButton(RadioButtonName="Circle", RadioButtonGroup="continuous_motion_output_behavior", InitiallySelected=False)
width_24 = Slider(310, range=0..400)
height_22 = Slider(30, range=0..30)
radiobtn_8 = CreateRadioButton(RadioButtonName="Press", RadioButtonGroup="continuous_motion_input_action", InitiallySelected=False)
width_25 = Slider(115, range=0..1000)
height_23 = Slider(35, range=0..1000)
slider_4 = CreateSlider(Slider=rounds, ShowBounds=False, ShowTicks=False, ShowTooltip=False, ShowValLabel=True, showLabel=True)
adjustpos_21 = AdjustElementPositioning(
    ElementsToAdjust=radiobtn_7,
    Margin="190,-55,0,10",
    AbsolutePositioning=False,
    Width=width_23,
    Height=height_21,
    HorizontalAlignment=Slider(0, range=0..100))
adjustpos_22 = AdjustElementPositioning(
    ElementsToAdjust=radiobtn_8,
    Margin="190,-55,0,10",
    AbsolutePositioning=False,
    Width=width_25,
    Height=height_23,
    HorizontalAlignment=Slider(0, range=0..100))
adjustpos_23 = AdjustElementPositioning(
    ElementsToAdjust=slider_4,
    Margin="10,0,0,10",
    AbsolutePositioning=False,
    Width=width_24,
    Height=height_22,
    HorizontalAlignment=Slider(0, range=0..100))
values_6 = ValueListener(Elements=radiobtn_7, SomeProperty=True)  # -> Values, Indices
values_7 = ValueListener(Elements=radiobtn_6, SomeProperty=True)  # -> Values, Indices
python_2 = GhPythonScript(x=values_7.Values, y=values_6.Values)  # -> a, b, c
# ---------- python_2: Python ----------
"""Provides a scripting component.
    Inputs:
        x: Translation option
        y: Rotation option
    Output:
        a: The second button
        b: The slide bar for translation
        c: The slide bar for rotation"""

__author__ = "ediga"
__version__ = "2020.08.18"

import rhinoscriptsyntax as rs

if x and not y:
    # translation
    a = "Set the direction"
    b = True
    c = False
elif not x and y:
    # rotation
    a = "Set the axis"
    b = False
    c = True
else:
    a = "Set the direction"
    b = True
    c = False
# ---------- end python_2 ----------
hideshow = HideShowElement(ElementToHideShow=slider_3, Show=python_2.b, Collapse=Toggle(True), Disable=Toggle(False))
panel = Panel(python_2.a)
true_button_4 = CreateTrueOnlyButton(ButtonName=panel, ButtonStyle=0)
adjustpos_24 = AdjustElementPositioning(
    ElementsToAdjust=true_button_4,
    Margin="120,-40,0,10",
    AbsolutePositioning=False,
    Width=width_14,
    Height=height_13,
    HorizontalAlignment=Slider(0, range=0..100))
hideshow_2 = HideShowElement(ElementToHideShow=slider_4, Show=python_2.c, Collapse=Toggle(True), Disable=Toggle(False))
merge = Merge(
    Data1=separator,
    Data2=label_5,
    Data3=label_4,
    Data4=radiobtn_5,
    Data5=radiobtn_8,
    Data7=label_2,
    Data8=radiobtn_6,
    Data9=radiobtn_7,
    Data10=separator_3,
    Data11=label_3,
    Data12=true_button,
    Data13=true_button_4,
    Data14=true_button_3,
    Data15=true_button_2,
    Data16=slider_2,
    Data17=slider_3,
    Data18=slider_4,
    Data19=separator_2,
    Data20=checkbox,
    Data21=button_2)
stack = CreateStack(UIElements=merge, Horizontal=Toggle(False))
values_8 = ValueListener(Elements=radiobtn_8, SomeProperty=True)  # -> Values, Indices
values_9 = ValueListener(Elements=radiobtn_5, SomeProperty=True)  # -> Values, Indices
hideshow_3 = HideShowElement(ElementToHideShow=stack, Show=python.b, Collapse=Toggle(True), Disable=Toggle(False))

# ---- group: Reciprocated Motion
strength_2 = Slider(0.5, range=0..1)
amplitude = Slider(10, range=0..20)
height_24 = Slider(30, range=0..30)
width_26 = Slider(380, range=0..400)
colour_6 = ColourPicker(PickedColour=RGB(101, 168, 99))
colour_7 = ColourPicker(PickedColour=RGB(230, 230, 230))
titlesize_3 = Slider(20, range=0..30)
width_27 = Slider(385, range=0..400)
height_25 = Slider(30, range=0..30)
width_28 = Slider(566, range=0..1000)
height_26 = Slider(38, range=0..1000)
slider_5 = CreateSlider(Slider=strength_2, ShowBounds=False, ShowTicks=False, ShowTooltip=False, ShowValLabel=True, showLabel=True)
slider_6 = CreateSlider(Slider=amplitude, ShowBounds=False, ShowTicks=False, ShowTooltip=False, ShowValLabel=True, showLabel=True)
width_29 = Slider(110, range=0..1000)
height_27 = Slider(35, range=0..1000)
separatorheight_4 = Slider(4, range=0..10)
width_30 = Slider(50, range=0..1000)
height_28 = Slider(30, range=0..1000)
width_31 = Slider(400, range=0..1000)
label_6 = CreateLabel(LabelText="Kinetic Unit for Reciprocated Motion", LabelSize=12, Justification=0)
adjustelem_3 = AdjustElementAppearance(ElementsToAdjust=label_6, Foreground=colour_6, FontSize=titlesize_3)
adjustpos_25 = AdjustElementPositioning(
    ElementsToAdjust=slider_5,
    Margin="10,5,0,5",
    AbsolutePositioning=False,
    Width=width_26,
    Height=height_24,
    HorizontalAlignment=Slider(0, range=0..100))
separatorheight_5 = Slider(4, range=0..10)
separator_4 = CreateSeparator(Thickness=0.5, Horizontal=True, Color=colour_7, Height=separatorheight_5)
adjustpos_26 = AdjustElementPositioning(
    ElementsToAdjust=slider_6,
    Margin="10,0,0,0",
    AbsolutePositioning=False,
    Width=width_27,
    Height=height_25,
    HorizontalAlignment=Slider(0, range=0..100))
adjustpos_27 = AdjustElementPositioning(
    ElementsToAdjust=label_6,
    Margin="10,5,0,20",
    AbsolutePositioning=False,
    Width=width_28,
    Height=height_26,
    HorizontalAlignment=Slider(0, range=0..100))
width_32 = Slider(150, range=0..1000)
height_29 = Slider(34, range=0..1000)
label_7 = CreateLabel(LabelText="Output trajectory:", LabelSize=12, Justification=0)
colour_8 = ColourPicker(PickedColour=RGB(230, 230, 230))
label_8 = CreateLabel(LabelText="Reciprocated Motion", LabelSize=12, Justification=0)
width_33 = Slider(450, range=0..1000)
true_button_5 = CreateTrueOnlyButton(ButtonName="Input", ButtonStyle=0)
panel_2 = Panel("""Uniform
Modified uniform
Uniform acceleration & deceleration""")
button_3 = CreateButton(ButtonName="Preview", ButtonStyle=0)
adjustpos_28 = AdjustElementPositioning(
    ElementsToAdjust=label_7,
    Margin="10,5,0,10",
    AbsolutePositioning=False,
    Width=width_29,
    Height=height_27,
    HorizontalAlignment=Slider(0, range=0..100))
width_34 = Slider(566, range=0..1000)
height_30 = Slider(38, range=0..1000)
width_35 = Slider(200, range=0..1000)
adjustpos_29 = AdjustElementPositioning(
    ElementsToAdjust=true_button_5,
    Margin="235,-40,0,10",
    AbsolutePositioning=False,
    Width=width_30,
    Height=height_28,
    HorizontalAlignment=Slider(0, range=0..100))
height_31 = Slider(30, range=0..1000)
height_32 = Slider(35, range=0..1000)
pulldown = CreatePulldownMenu(Label="Pattern", ListItems=panel_2, showLabel=True)
width_36 = Slider(110, range=0..1000)
height_33 = Slider(35, range=0..1000)
separator_5 = CreateSeparator(Thickness=0.5, Horizontal=True, Color=colour_8, Width=width_31, Height=separatorheight_4)
checkbox_2 = CreateCheckbox(Label="Add a lock", StartingValue=False)
adjustpos_30 = AdjustElementPositioning(
    ElementsToAdjust=pulldown,
    Margin="10,0,0,10",
    AbsolutePositioning=False,
    Width=width_32,
    Height=height_29,
    HorizontalAlignment=Slider(0, range=0..100))
radiobtn_9 = CreateRadioButton(RadioButtonName="Line", RadioButtonGroup="reciprocated_motion_output", InitiallySelected=False)
width_37 = Slider(100, range=0..1000)
height_34 = Slider(30, range=0..1000)
width_38 = Slider(80, range=0..1000)
height_35 = Slider(30, range=0..1000)
repetitions = Slider(10, range=0..20)
width_39 = Slider(100, range=0..1000)
adjustpos_31 = AdjustElementPositioning(
    ElementsToAdjust=button_3,
    Margin="165,-45,0,10",
    AbsolutePositioning=False,
    Width=width_35,
    Height=height_31,
    HorizontalAlignment=Slider(0, range=0..100))
height_36 = Slider(30, range=0..1000)
adjustpos_32 = AdjustElementPositioning(ElementsToAdjust=checkbox_2, Margin="15,5,0,10", AbsolutePositioning=False, Width=width_33, Height=height_32)
adjustpos_33 = AdjustElementPositioning(
    ElementsToAdjust=label_8,
    Margin="10,5,0,10",
    AbsolutePositioning=False,
    Width=width_34,
    Height=height_30,
    HorizontalAlignment=Slider(0, range=0..100))
adjustpos_34 = AdjustElementPositioning(
    ElementsToAdjust=radiobtn_9,
    Margin="125,-55,0,10",
    AbsolutePositioning=False,
    Width=width_36,
    Height=height_33,
    HorizontalAlignment=Slider(0, range=0..100))
separatorheight_6 = Slider(10, range=0..10)
colour_9 = ColourPicker(PickedColour=RGB(230, 230, 230))
width_40 = Slider(400, range=0..1000)
height_37 = Slider(30, range=0..30)
width_41 = Slider(170, range=0..400)
colour_10 = ColourPicker(PickedColour=RGB(51, 121, 200))
true_button_6 = CreateTrueOnlyButton(ButtonName="Set the direction", ButtonStyle=0)
true_button_7 = CreateTrueOnlyButton(ButtonName="End-effector", ButtonStyle=0)
true_button_8 = CreateTrueOnlyButton(ButtonName="Select a region", ButtonStyle=0)
slider_7 = CreateSlider(Slider=repetitions, ShowBounds=False, ShowTicks=False, ShowTooltip=False, ShowValLabel=True, showLabel=True)
adjustpos_35 = AdjustElementPositioning(
    ElementsToAdjust=true_button_6,
    Margin="120,-40,0,10",
    AbsolutePositioning=False,
    Width=width_37,
    Height=height_34,
    HorizontalAlignment=Slider(0, range=0..100))
adjustpos_36 = AdjustElementPositioning(
    ElementsToAdjust=true_button_7,
    Margin="300,-40,0,15",
    AbsolutePositioning=False,
    Width=width_38,
    Height=height_35,
    HorizontalAlignment=Slider(0, range=0..100))
adjustpos_37 = AdjustElementPositioning(
    ElementsToAdjust=true_button_8,
    Margin="10,0,0,10",
    AbsolutePositioning=False,
    Width=width_39,
    Height=height_36,
    HorizontalAlignment=Slider(0, range=0..100))
separator_6 = CreateSeparator(Thickness=0.5, Horizontal=True, Color=colour_9, Width=width_40, Height=separatorheight_6)
adjustpos_38 = AdjustElementPositioning(
    ElementsToAdjust=slider_7,
    Margin="170,-55,0,5",
    AbsolutePositioning=False,
    Width=width_41,
    Height=height_37,
    HorizontalAlignment=Slider(0, range=0..100))
height_38 = Slider(35, range=0..1000)
width_42 = Slider(115, range=0..1000)
titlesize_4 = Slider(20, range=0..30)
adjustelem_4 = AdjustElementAppearance(ElementsToAdjust=label_8, Foreground=colour_10, FontSize=titlesize_4)
radiobtn_10 = CreateRadioButton(RadioButtonName="Arc", RadioButtonGroup="reciprocated_motion_output", InitiallySelected=False)
merge_2 = Merge(
    Data1=separator_4,
    Data2=label_8,
    Data3=label_7,
    Data4=radiobtn_9,
    Data5=radiobtn_10,
    Data9=separator_5,
    Data10=label_6,
    Data11=true_button_8,
    Data12=true_button_6,
    Data13=true_button_5,
    Data14=true_button_7,
    Data15=slider_5,
    Data16=pulldown,
    Data18=slider_7,
    Data19=slider_6,
    Data22=separator_6,
    Data23=checkbox_2,
    Data24=button_3)
stack_2 = CreateStack(UIElements=merge_2, Horizontal=Toggle(False))
hideshow_4 = HideShowElement(ElementToHideShow=stack_2, Show=python.c, Collapse=Toggle(True), Disable=Toggle(False))
values_10 = ValueListener(Elements=radiobtn_9, SomeProperty=True)  # -> Values, Indices
values_11 = ValueListener(Elements=radiobtn_10, SomeProperty=True)  # -> Values, Indices
adjustpos_39 = AdjustElementPositioning(
    ElementsToAdjust=radiobtn_10,
    Margin="190,-55,0,10",
    AbsolutePositioning=False,
    Width=width_42,
    Height=height_38,
    HorizontalAlignment=Slider(0, range=0..100))

# ---- group: Intermittent Motion
separatorheight_7 = Slider(4, range=0..10)
separatorheight_8 = Slider(10, range=0..10)
colour_11 = ColourPicker(PickedColour=RGB(101, 168, 99))
colour_12 = ColourPicker(PickedColour=RGB(230, 230, 230))
width_43 = Slider(400, range=0..1000)
colour_13 = ColourPicker(PickedColour=RGB(230, 230, 230))
width_44 = Slider(566, range=0..1000)
height_39 = Slider(38, range=0..1000)
titlesize_5 = Slider(20, range=0..30)
label_9 = CreateLabel(LabelText="Kinetic Unit for Intermittent Motion", LabelSize=12, Justification=0)
separator_7 = CreateSeparator(Thickness=0.5, Horizontal=True, Color=colour_13, Width=width_43, Height=separatorheight_8)
separator_8 = CreateSeparator(Thickness=0.5, Horizontal=True, Color=colour_12, Height=separatorheight_7)
width_45 = Slider(100, range=0..1000)
height_40 = Slider(30, range=0..1000)
adjustpos_40 = AdjustElementPositioning(
    ElementsToAdjust=label_9,
    Margin="10,0,0,20",
    AbsolutePositioning=False,
    Width=width_44,
    Height=height_39,
    HorizontalAlignment=Slider(0, range=0..100))
adjustelem_5 = AdjustElementAppearance(ElementsToAdjust=label_9, Foreground=colour_11, FontSize=titlesize_5)
width_46 = Slider(566, range=0..1000)
height_41 = Slider(38, range=0..1000)
width_47 = Slider(100, range=0..1000)
height_42 = Slider(30, range=0..1000)
interval = Slider(10, range=0..20)
amplitude_2 = Slider(10, range=0..20)
strength_3 = Slider(0.5, range=0..1)
width_48 = Slider(380, range=0..400)
height_43 = Slider(30, range=0..30)
width_49 = Slider(380, range=0..400)
width_50 = Slider(380, range=0..400)
width_51 = Slider(85, range=0..1000)
height_44 = Slider(30, range=0..30)
height_45 = Slider(30, range=0..30)
width_52 = Slider(50, range=0..1000)
height_46 = Slider(30, range=0..1000)
height_47 = Slider(30, range=0..1000)
true_button_9 = CreateTrueOnlyButton(ButtonName="Select a region", ButtonStyle=0)
width_53 = Slider(200, range=0..1000)
height_48 = Slider(30, range=0..1000)
label_10 = CreateLabel(LabelText="Intermittent Motion", LabelSize=12, Justification=0)
adjustpos_41 = AdjustElementPositioning(
    ElementsToAdjust=true_button_9,
    Margin="15,0,0,10",
    AbsolutePositioning=False,
    Width=width_45,
    Height=height_40,
    HorizontalAlignment=Slider(0, range=0..100))
button_4 = CreateButton(ButtonName="Preview", ButtonStyle=0)
slider_8 = CreateSlider(Slider=strength_3, ShowBounds=False, ShowTicks=False, ShowTooltip=False, ShowValLabel=True, showLabel=True)
true_button_10 = CreateTrueOnlyButton(ButtonName="End-effector", ButtonStyle=0)
slider_9 = CreateSlider(Slider=interval, ShowBounds=False, ShowTicks=False, ShowTooltip=False, ShowValLabel=True, showLabel=True)
slider_10 = CreateSlider(Slider=amplitude_2, ShowBounds=False, ShowTicks=False, ShowTooltip=False, ShowValLabel=True, showLabel=True)
true_button_11 = CreateTrueOnlyButton(ButtonName="Set the direction", ButtonStyle=0)
true_button_12 = CreateTrueOnlyButton(ButtonName="Input", ButtonStyle=0)
adjustpos_42 = AdjustElementPositioning(
    ElementsToAdjust=label_10,
    Margin="10,5,0,5",
    AbsolutePositioning=False,
    Width=width_46,
    Height=height_41,
    HorizontalAlignment=Slider(0, range=0..100))
adjustpos_43 = AdjustElementPositioning(
    ElementsToAdjust=button_4,
    Margin="180,-45,0,10",
    AbsolutePositioning=False,
    Width=width_53,
    Height=height_48,
    HorizontalAlignment=Slider(0, range=0..100))
adjustpos_44 = AdjustElementPositioning(
    ElementsToAdjust=true_button_10,
    Margin="295,-40,0,20",
    AbsolutePositioning=False,
    Width=width_51,
    Height=height_46,
    HorizontalAlignment=Slider(0, range=0..100))
adjustpos_45 = AdjustElementPositioning(
    ElementsToAdjust=slider_8,
    Margin="10,15,0,20",
    AbsolutePositioning=False,
    Width=width_48,
    Height=height_43,
    HorizontalAlignment=Slider(0, range=0..100))
adjustpos_46 = AdjustElementPositioning(
    ElementsToAdjust=true_button_12,
    Margin="235,-40,0,10",
    AbsolutePositioning=False,
    Width=width_52,
    Height=height_47,
    HorizontalAlignment=Slider(0, range=0..100))
adjustpos_47 = AdjustElementPositioning(
    ElementsToAdjust=true_button_11,
    Margin="125,-40,0,10",
    AbsolutePositioning=False,
    Width=width_47,
    Height=height_42,
    HorizontalAlignment=Slider(0, range=0..100))
adjustpos_48 = AdjustElementPositioning(
    ElementsToAdjust=slider_9,
    Margin="10,0,0,5",
    AbsolutePositioning=False,
    Width=width_49,
    Height=height_44,
    HorizontalAlignment=Slider(0, range=0..100))
adjustpos_49 = AdjustElementPositioning(
    ElementsToAdjust=slider_10,
    Margin="10,15,0,15",
    AbsolutePositioning=False,
    Width=width_50,
    Height=height_45,
    HorizontalAlignment=Slider(0, range=0..100))
width_54 = Slider(450, range=0..1000)
height_49 = Slider(35, range=0..1000)
titlesize_6 = Slider(20, range=0..30)
colour_14 = ColourPicker(PickedColour=RGB(51, 121, 200))
adjustelem_6 = AdjustElementAppearance(ElementsToAdjust=label_10, Foreground=colour_14, FontSize=titlesize_6)
checkbox_3 = CreateCheckbox(Label="Add a lock", StartingValue=False)
merge_3 = Merge(
    Data1=separator_8,
    Data2=label_10,
    Data3=label_9,
    Data4=true_button_9,
    Data5=true_button_11,
    Data6=true_button_12,
    Data7=true_button_10,
    Data8=slider_8,
    Data9=slider_9,
    Data10=slider_10,
    Data11=separator_7,
    Data12=checkbox_3,
    Data13=button_4)
adjustpos_50 = AdjustElementPositioning(ElementsToAdjust=checkbox_3, Margin="15,15,0,10", AbsolutePositioning=False, Width=width_54, Height=height_49)
stack_3 = CreateStack(UIElements=merge_3, Horizontal=Toggle(False))
hideshow_5 = HideShowElement(ElementToHideShow=stack_3, Show=python.d, Collapse=Toggle(True), Disable=Toggle(False))

# ---- group: Default Control Panel
width_55 = Slider(860, range=0..1000)
height_50 = Slider(35, range=0..1000)
colour_15 = ColourPicker(PickedColour=RGB(200, 200, 200))
label_11 = CreateLabel(LabelText="Please select the target motion...", LabelSize=12, Justification=0)
adjustpos_51 = AdjustElementPositioning(
    ElementsToAdjust=label_11,
    Margin="100,180,0,10",
    AbsolutePositioning=False,
    Width=width_55,
    Height=height_50,
    HorizontalAlignment=Slider(0, range=0..100))
stack_4 = CreateStack(UIElements=label_11, Horizontal=Toggle(False))
hideshow_6 = HideShowElement(ElementToHideShow=stack_4, Show=python.e, Collapse=Toggle(True), Disable=Toggle(False))
adjustelem_7 = AdjustElementAppearance(ElementsToAdjust=label_11, Foreground=colour_15)

# ----
height_51 = Slider(35, range=0..1000)
width_56 = Slider(115, range=0..1000)
radiobtn_11 = CreateRadioButton(RadioButtonName="Arc", RadioButtonGroup="instant_motion", InitiallySelected=False)
values_12 = ValueListener(Elements=radiobtn_11, SomeProperty=True)  # -> Values, Indices

# ---- group: Instant Motion
separatorheight_9 = Slider(4, range=0..10)
colour_16 = ColourPicker(PickedColour=RGB(230, 230, 230))
colour_17 = ColourPicker(PickedColour=RGB(101, 168, 99))
width_57 = Slider(566, range=0..1000)
height_52 = Slider(38, range=0..1000)
rounds_2 = Slider(10.187, range=0..20)
titlesize_7 = Slider(20, range=0..30)
strength_4 = Slider(0.5, range=0..1)
displacement = Slider(10.187, range=0..20)
separator_9 = CreateSeparator(Thickness=0.5, Horizontal=True, Color=colour_16, Height=separatorheight_9)
label_12 = CreateLabel(LabelText="Kinetic Unit for Instant Motion", LabelSize=12, Justification=0)
width_58 = Slider(203, range=0..1000)
height_53 = Slider(35, range=0..1000)
label_13 = CreateLabel(LabelText="Output trajectory:", LabelSize=12, Justification=0)
width_59 = Slider(385, range=0..400)
height_54 = Slider(30, range=0..30)
adjustpos_52 = AdjustElementPositioning(
    ElementsToAdjust=label_12,
    Margin="10,5,0,20",
    AbsolutePositioning=False,
    Width=width_57,
    Height=height_52,
    HorizontalAlignment=Slider(0, range=0..100))
adjustelem_8 = AdjustElementAppearance(ElementsToAdjust=label_12, Foreground=colour_17, FontSize=titlesize_7)
width_60 = Slider(170, range=0..1000)
height_55 = Slider(30, range=0..1000)
slider_11 = CreateSlider(Slider=rounds_2, ShowBounds=False, ShowTicks=False, ShowTooltip=False, ShowValLabel=True, showLabel=True)
width_61 = Slider(380, range=0..400)
height_56 = Slider(30, range=0..30)
width_62 = Slider(385, range=0..400)
height_57 = Slider(30, range=0..30)
slider_12 = CreateSlider(Slider=strength_4, ShowBounds=False, ShowTicks=False, ShowTooltip=False, ShowValLabel=True, showLabel=True)
slider_13 = CreateSlider(Slider=displacement, ShowBounds=False, ShowTicks=False, ShowTooltip=False, ShowValLabel=True, showLabel=True)
adjustpos_53 = AdjustElementPositioning(
    ElementsToAdjust=label_13,
    Margin="10,5,0,10",
    AbsolutePositioning=False,
    Width=width_58,
    Height=height_53,
    HorizontalAlignment=Slider(0, range=0..100))
adjustpos_54 = AdjustElementPositioning(
    ElementsToAdjust=slider_11,
    Margin="10,10,0,5",
    AbsolutePositioning=False,
    Width=width_59,
    Height=height_54,
    HorizontalAlignment=Slider(0, range=0..100))
height_58 = Slider(38, range=0..1000)
adjustpos_55 = AdjustElementPositioning(
    ElementsToAdjust=slider_12,
    Margin="10,20,0,10",
    AbsolutePositioning=False,
    Width=width_61,
    Height=height_56,
    HorizontalAlignment=Slider(0, range=0..100))
adjustpos_56 = AdjustElementPositioning(
    ElementsToAdjust=slider_13,
    Margin="10,10,0,5",
    AbsolutePositioning=False,
    Width=width_62,
    Height=height_57,
    HorizontalAlignment=Slider(0, range=0..100))
label_14 = CreateLabel(LabelText="Instant Motion", LabelSize=12, Justification=0)
width_63 = Slider(566, range=0..1000)
width_64 = Slider(110, range=0..1000)
height_59 = Slider(35, range=0..1000)
separatorheight_10 = Slider(10, range=0..10)
radiobtn_12 = CreateRadioButton(RadioButtonName="Line", RadioButtonGroup="instant_motion", InitiallySelected=False)
values_13 = ValueListener(Elements=radiobtn_12, SomeProperty=True)  # -> Values, Indices
colour_18 = ColourPicker(PickedColour=RGB(230, 230, 230))
width_65 = Slider(400, range=0..1000)
width_66 = Slider(170, range=0..1000)
height_60 = Slider(30, range=0..1000)
adjustpos_57 = AdjustElementPositioning(
    ElementsToAdjust=label_14,
    Margin="10,5,0,10",
    AbsolutePositioning=False,
    Width=width_63,
    Height=height_58,
    HorizontalAlignment=Slider(0, range=0..100))
separator_10 = CreateSeparator(Thickness=0.5, Horizontal=True, Color=colour_18, Width=width_65, Height=separatorheight_10)
adjustpos_58 = AdjustElementPositioning(
    ElementsToAdjust=radiobtn_12,
    Margin="130,-55,0,10",
    AbsolutePositioning=False,
    Width=width_64,
    Height=height_59,
    HorizontalAlignment=Slider(0, range=0..100))
titlesize_8 = Slider(20, range=0..30)
colour_19 = ColourPicker(PickedColour=RGB(51, 121, 200))
checkbox_4 = CreateCheckbox(Label="Add a lock", StartingValue=False)
colour_20 = ColourPicker(PickedColour=RGB(230, 230, 230))
button_5 = CreateButton(ButtonName="Preview", ButtonStyle=0)
adjustelem_9 = AdjustElementAppearance(ElementsToAdjust=label_14, Foreground=colour_19, FontSize=titlesize_8)
width_67 = Slider(200, range=0..1000)
height_61 = Slider(30, range=0..1000)
width_68 = Slider(450, range=0..1000)
height_62 = Slider(35, range=0..1000)
height_63 = Slider(35, range=0..1000)
width_69 = Slider(115, range=0..1000)
radiobtn_13 = CreateRadioButton(RadioButtonName="Circle", RadioButtonGroup="instant_motion", InitiallySelected=False)
values_14 = ValueListener(Elements=radiobtn_13, SomeProperty=True)  # -> Values, Indices
python_3 = GhPythonScript(x=values_13.Values, y=values_14.Values, z=values_12.Values)  # -> a, b, c, d, e
# ---------- python_3: Python ----------
"""Provides a scripting component.
    Inputs:
        x: Line
        y: Circle
        z: Arc
    Output:
        a: button 1 label
        b: button 2 lable
        c: hide or show the slide bar for translation
        d: hide or show the slide bar for rotation
        e: hide or show the slide bar for hinge pivoting"""

__author__ = "ediga"
__version__ = "2020.07.29"

import rhinoscriptsyntax as rs

if x and not y and not z:
    a = "Select a region"
    b = "Set the translation direction"
    c = True
    d = False
    e = False
elif not x and y and not z:
    a = "Select a region"
    b = "Set the rotation axis"
    c = False
    d = True
    e = False
elif not x and not y and z:
    a = "Select a region"
    b = "Set the pivoting axis"
    c = False
    d = False
    e = True
else:
    a = "Select a region"
    b = "Set the translation direction"
    c = True
    d = False
    e = False
# ---------- end python_3 ----------
hideshow_7 = HideShowElement(ElementToHideShow=slider_11, Show=python_3.d, Collapse=Toggle(True), Disable=Toggle(False))
hideshow_8 = HideShowElement(ElementToHideShow=slider_13, Show=python_3.c, Collapse=Toggle(True), Disable=Toggle(False))
panel_3 = Panel(python_3.a)
true_button_13 = CreateTrueOnlyButton(ButtonName=panel_3, ButtonStyle=0)
adjustpos_59 = AdjustElementPositioning(
    ElementsToAdjust=true_button_13,
    Margin="15,0,0,10",
    AbsolutePositioning=False,
    Width=width_60,
    Height=height_55,
    HorizontalAlignment=Slider(0, range=0..100))
panel_4 = Panel(python_3.b)
true_button_14 = CreateTrueOnlyButton(ButtonName=panel_4, ButtonStyle=0)
adjustpos_60 = AdjustElementPositioning(
    ElementsToAdjust=true_button_14,
    Margin="200,-40,0,10",
    AbsolutePositioning=False,
    Width=width_66,
    Height=height_60,
    HorizontalAlignment=Slider(0, range=0..100))
separatorheight_11 = Slider(4, range=0..10)
width_70 = Slider(400, range=0..1000)
adjustpos_61 = AdjustElementPositioning(
    ElementsToAdjust=button_5,
    Margin="180,-45,0,10",
    AbsolutePositioning=False,
    Width=width_67,
    Height=height_61,
    HorizontalAlignment=Slider(0, range=0..100))
adjustpos_62 = AdjustElementPositioning(ElementsToAdjust=checkbox_4, Margin="15,15,0,10", AbsolutePositioning=False, Width=width_68, Height=height_62)
adjustpos_63 = AdjustElementPositioning(
    ElementsToAdjust=radiobtn_13,
    Margin="190,-55,0,10",
    AbsolutePositioning=False,
    Width=width_69,
    Height=height_63,
    HorizontalAlignment=Slider(0, range=0..100))
separator_11 = CreateSeparator(Thickness=0.5, Horizontal=True, Color=colour_20, Width=width_70, Height=separatorheight_11)
merge_4 = Merge(
    Data1=separator_9,
    Data2=label_14,
    Data3=label_13,
    Data4=radiobtn_12,
    Data5=radiobtn_13,
    Data6=radiobtn_11,
    Data8=separator_11,
    Data9=label_12,
    Data10=true_button_13,
    Data11=true_button_14,
    Data12=slider_12,
    Data13=slider_13,
    Data14=slider_11,
    Data15=slider,
    Data16=separator_10,
    Data17=checkbox_4,
    Data18=button_5)
stack_5 = CreateStack(UIElements=merge_4, Horizontal=Toggle(False))
hideshow_9 = HideShowElement(ElementToHideShow=stack_5, Show=python.a, Collapse=Toggle(True), Disable=Toggle(False))

# ----
hideshow_10 = HideShowElement(ElementToHideShow=slider, Show=python_3.e, Collapse=Toggle(True), Disable=Toggle(False))
adjustpos_64 = AdjustElementPositioning(
    ElementsToAdjust=radiobtn_11,
    Margin="265,-55,0,10",
    AbsolutePositioning=False,
    Width=width_56,
    Height=height_51,
    HorizontalAlignment=Slider(0, range=0..100))
arc = Panel(values_11.Values)
line = Panel(values_10.Values)
turn_input = Panel(values_9.Values)
press_input = Panel(values_8.Values)
line_2 = Panel(values_7.Values)
circle = Panel(values_6.Values)
panel_5 = Panel(python.b)
panel_6 = Panel(python.a)
panel_7 = Panel(python.c)
panel_8 = Panel(python.e)
line_3 = Panel(values_13.Values)
panel_9 = Panel(python.d)
circle_2 = Panel(values_14.Values)
arc_2 = Panel(values_12.Values)

# ---- group: MAIN WINDOW
merge_5 = Merge(
    Data1=label,
    Data2=radiobtn_3,
    Data3=radiobtn_4,
    Data4=radiobtn_2,
    Data5=radiobtn,
    Data7=stack_4,
    Data8=stack_5,
    Data9=stack,
    Data10=stack_2,
    Data11=stack_3)
launchwin = LaunchWindow(
    Show=Toggle(True),
    Name="Kinergy Design Tool",
    Width=Slider(410, range=0..1000),
    Height=Slider(520, range=0..1000),
    ChildStatus=0,
    EnableHorizScroll=False)
addelems = AddElements(Window=launchwin, Elements=flatten(merge_5), DoVLChecking=True)  # -> AddedElements, ElementNames
